# Grasshopper definition 0_GRASSHOPPER-PYTHON.gh (Grasshopper 1.0.7)
# Copyright : © PAZ - Parametric Academy Zurich
# 
# Rhinoceros 3D NURBS Modeling Software, Grasshopper Parametric Design Software and Python are connected with most of the AEC Software.

# ----
# HELLO GRASSHOPPER
panel = Panel("2_GH-PY")

# ----
# HELLO PYTHON GRASSHOPPER
panel_2 = Panel("2_GH-PY")

# ----
# PYTHON GRASSHOPPER
panel_3 = Panel("2_GH-PY")

# ---- group: LIST
series = Series(Start="2", Step=1, Count=10)
series_2 = Series(Start=0, Step=1, Count=Slider(4, range=0..10))
item = ListItem(List=series, Index=series_2, Wrap=True)
panel_4 = Panel(series)
panel_5 = Panel(item)

# ---- group: EXPRESSION
expression = Expression(Expression="Format(\"{0}, {1}\", x, y)")

# ---- group: MATRIX
matrix = ConstructMatrix(Rows=3, Columns=3)
matrix_2 = DisplayMatrix(matrix)

# ---- group: HELLO POINT
python = GhPythonScript()  # -> out, a
# ---------- python: Python ----------
__author__ = """PAZ_Academy = [["PAZ - Parametric Academy Zurich", "https://pazacademy.ch", "info@pazacademy.ch", "+41 44 243 62 16"],["PAZ Central" , "Niederdorfstrasse 77", "CH-8001 Zurich"]]"""
__course__ = """Y1 - Python AEC > Python AEC is a full day Python course for Architects, Engineers and BIM professionals. Analyze, Optimize and Automatize with Python your normal day AEC workflows !"""
__stage__ = """2_GRASSHOPPER-PYTHON > Let's learn how to develop our first Scripts inside Grasshopper with Python :D !!! """

import rhinoscriptsyntax as rs #Load rhinoscriptsyntax aka rs

point = rs.AddPoint(0,0,0) #This is a Rhino Point ;D !

a = point #Now send to the component output a my point ;)
# ---------- end python ----------

# ---- group: https://pazacademy.ch/product/pss-parametric-system-specialist/
panel_6 = Panel("2_GRASSHOPPER PYTHON")
# Rhinoceros 3D NURBS Modeling Software, Grasshopper Parametric Design Software and Python are connected with most of the AEC Software.
panel_7 = Panel("Y1 - PYTHON AEC")
panel_8 = Panel("www.pazacademy.ch")
# Definition created by PAZ - Parametric Academy Zurich :)
# HELP Computational Design Platform :D
# For Architects, Designers, Draftsman's and Engineers
# Copyright : © PAZ - Parametric Academy Zurich
panel_9 = Panel("info@pazacademy.ch")

# ---- group: TRIGONOMETRY
# Hello Grasshopper ;D !
# 
# Remember, Remember the Grasshopper Enviroment, Beautiful and Amazing work to do our Coding Lifes Much easier :D !!!
rtrig = RightTrigonometry()  # -> Alpha, Beta, PLength, QLength, RLength

# ----
# And here the most important Python steps to Start our Projects :D ! Point, Inputs, List, 2D & 3D :D !
panel_10 = Panel(python.a)

# ---- group: TREE BRANCHES
cir = Circle(Plane=PlaneXY(0, 0, 0), Radius=1)
divide = DivideCurve(Curve=cir, Count=10, Kinks=False)  # -> Points, Tangents, Parameters

# ---- group: GALAPAGOS
number_slider = Slider(0.779, range=0..1)
number_slider_2 = Slider(1, range=0..1)
pt = ConstructPoint(XCoordinate=number_slider, YCoordinate=number_slider_2, ZCoordinate=0)
sph = Sphere(Base=PlaneXY(0, 0, 0), Radius=1)
evalsrf = EvaluateSurface(Surface=sph, Point=pt)  # -> Point, Normal, UDirection, VDirection, Frame
pdecon = Deconstruct(Point=evalsrf.Point)  # -> XComponent, YComponent, ZComponent
galapagos = Galapagos(fitness=num, gene=[number_slider, number_slider_2])
num = Number(pdecon.ZComponent)
panel_11 = Panel(num)

# ---- group: TREE BRANCHES
cir_2 = Circle(Plane=divide.Points, Radius=1)
divide_2 = DivideCurve(Curve=cir_2, Count=10, Kinks=False)  # -> Points, Tangents, Parameters

cir_3 = Circle(Plane=divide_2.Points, Radius=1)
divide_3 = DivideCurve(Curve=cir_3, Count=10, Kinks=False)  # -> Points, Tangents, Parameters

panel_12 = Panel(cir)
viewer = ParamViewer(cir)
panel_13 = Panel(cir_2)
viewer_2 = ParamViewer(cir_2)
viewer_3 = ParamViewer(cir_3)
item_2 = ListItem(List=cir_3, Index=Slider(3, range=0..10), Wrap=True)
panel_14 = Panel(item_2)

# ---- group: RHINOSCRIPTSYNTAX
python_2 = GhPythonScript(x=Slider(10, range=0..24))  # -> out, a
# ---------- python_2: Python ----------
# sample script to show how to use this component and the rhinoscriptsyntax
"""Constructs a sinusoidal series of circles.
  Inputs:
    x: The number of circles. (integer)
    y: The radius of each circle. (float)
  Outputs:
    a: The list of circles. (list of circle)
    b: The list of radii. (list of float)
"""
import math
import rhinoscriptsyntax as rs

if x is None:
    x = 24    # if nothing is connected to x, set x to something (24).
if y is None:
    y = 0.3    # if nothing is connected to y, set y to 0.3.

circles = []            # create a list. We will add IDs to it later on.
radii = []              # ...and create another one.

for i in range(int(x)):
    pt = (i, math.cos(i), 0)             # a tuple (here for a point).
    id1 = rs.AddCircle(pt, y)
    circles.append(id1)
    endPt = rs.PointAdd(pt, (0, 0.3, 0)) # move the point by the vector.
    id2 = rs.AddLine(pt, endPt)
    radii.append(id2)

a = circles
b = radii
# ---------- end python_2 ----------

# ----
# Let's warm it up with the Python Amazing Examples inside our Components ;D !
panel_15 = Panel(python_2.a)

# ---- group: HELLO LIST
python_3 = GhPythonScript(x=Slider(7, range=1..10))  # -> out, a; inputs x: Int32
# ---------- python_3: Python ----------
__author__ = """PAZ_Academy = [["PAZ - Parametric Academy Zurich", "https://pazacademy.ch", "info@pazacademy.ch", "+41 44 243 62 16"],["PAZ Central" , "Niederdorfstrasse 77", "CH-8001 Zurich"]]"""
__course__ = """Y1 - Python AEC > Python AEC is a full day Python course for Architects, Engineers and BIM professionals. Analyze, Optimize and Automatize with Python your normal day AEC workflows !"""
__stage__ = """2_GRASSHOPPER-PYTHON > Let's learn how to develop our first Scripts inside Grasshopper with Python :D !!! """

import rhinoscriptsyntax as rs #we load a cool library called rhinoscripsyntax doing our life much more easy :D !!!

points = [] #We need to create an empty list, REALLY REALLY REALLY IMPORTANT when we work with list !

for i in range(x): #Create a loop for with the variable i repeating range number x (type hint INT) Nº of times :D
    point = rs.AddPoint(i,i,i) #Each "i"teration will generate a Rhino point (0,0,0), (1,1,1)...
    points.append(point) #List Method to attach each point in our [] Empy list ;D !
    print(i) #Our variable i ready to get the inputs from 0 to (x) ;D ! 

a = points #Export my final List of Points :D !
# ---------- end python_3 ----------

# ----
panel_16 = Panel(python_3.out)
panel_17 = Panel(python_3.a)

# ---- group: HELLO 2D
python_4 = GhPythonScript(x=Slider(11, range=1..11), y=Slider(11, range=1..11))  # -> out, a; inputs x: Int32, y: Int32
# ---------- python_4: Python ----------
__author__ = """PAZ_Academy = [["PAZ - Parametric Academy Zurich", "https://pazacademy.ch", "info@pazacademy.ch", "+41 44 243 62 16"],["PAZ Central" , "Niederdorfstrasse 77", "CH-8001 Zurich"]]"""
__course__ = """Y1 - Python AEC > Python AEC is a full day Python course for Architects, Engineers and BIM professionals. Analyze, Optimize and Automatize with Python your normal day AEC workflows !"""
__stage__ = """2_GRASSHOPPER-PYTHON > Let's learn how to develop our first Scripts inside Grasshopper with Python :D !!! """

import rhinoscriptsyntax as rs #We load a cool library called rhinoscripsyntax doing our life much more easy :D !!!

points = [] #We need to create an empty list, REALLY REALLY REALLY IMPORTANT when we work with list !

for i in range(x): #Create a loop for with the variable i repeating range number x (type hint INT) Nº of times :D
    for v in range(y): #This is a Nested Loop for creating the 2º Dimension of our Future Points ;D !
        point = rs.AddPoint(i,v,0) #Each "i" and then "v" iteration will generate a Rhino point (0,0,0), (1,1,1)... 
        points.append(point) #List Method to attach each point in our [] Empy list ;D !
        print(i) #Our variable i ready to get the inputs from 0 to (x) ;D ! 

a = points #Export my final List of Points :D !
# ---------- end python_4 ----------

# ----
panel_18 = Panel(python_4.a)

Z = Slider(10, range=1..11)

# ---- group: HELLO 3D
python_5 = GhPythonScript(x=Slider(7, range=1..11), y=Slider(8, range=1..11), z=Z)  # -> out, a; inputs x: Int32, y: Int32, z: Int32
# ---------- python_5: Python ----------
__author__ = """PAZ_Academy = [["PAZ - Parametric Academy Zurich", "https://pazacademy.ch", "info@pazacademy.ch", "+41 44 243 62 16"],["PAZ Central" , "Niederdorfstrasse 77", "CH-8001 Zurich"]]"""
__course__ = """Y1 - Python AEC > Python AEC is a full day Python course for Architects, Engineers and BIM professionals. Analyze, Optimize and Automatize with Python your normal day AEC workflows !"""
__stage__ = """2_GRASSHOPPER-PYTHON > Let's learn how to develop our first Scripts inside Grasshopper with Python :D !!! """

import rhinoscriptsyntax as rs #we load a cool library called rhinoscripsyntax doing our life much more easy :D !!!

points = [] #We need to create an empty list, REALLY REALLY REALLY IMPORTANT when we work with list !

for i in range(x): #Create a loop for with the variable i repeating range number x (type hint INT) Nº of times :D
    for v in range(y): #This is a Nested Loop for creating the 2º Dimension of our Future Points ;D !
        for w in range(z): #And here our 3D we conquer the Space :D !
            point = rs.AddPoint(i,v,w) #Each "i" and then "v" and then "w" iteration will generate a Rhino point (0,0,0), (1,1,1)...
            points.append(point) #List Method to attach each point in our [] Empy list ;D !
            print(i) #Our variable i ready to get the inputs from 0 to (x) ;D ! 

a = points #Export my final List of Points :D !
# ---------- end python_5 ----------

# ----
panel_19 = Panel(python_5.a)

# ---- group: HELLO INPUTS
python_6 = GhPythonScript(x=Slider(4.943, range=0..10))  # -> out, a
# ---------- python_6: Python ----------
__author__ = """PAZ_Academy = [["PAZ - Parametric Academy Zurich", "https://pazacademy.ch", "info@pazacademy.ch", "+41 44 243 62 16"],["PAZ Central" , "Niederdorfstrasse 77", "CH-8001 Zurich"]]"""
__course__ = """Y1 - Python AEC > Python AEC is a full day Python course for Architects, Engineers and BIM professionals. Analyze, Optimize and Automatize with Python your normal day AEC workflows !"""
__stage__ = """2_GRASSHOPPER-PYTHON > Let's learn how to develop our first Scripts inside Grasshopper with Python :D !!! """

import rhinoscriptsyntax as rs #Load rhinoscriptsyntax aka rs

point = rs.AddPoint(x,x,x) #This is a Rhino Point with External x input ;D !!!

a = point #Now send to the component output a my point ;)
# ---------- end python_6 ----------

# ----
panel_20 = Panel(python_6.a)

pt_2 = Point(Point(2, 1.11553041, 0))
pt_3 = Point(Point(6, 3, 0))
ln = Line(StartPoint=pt_2, EndPoint=pt_3)

# ---- group: RHINO.COMMON
python_7 = GhPythonScript(x=ln)  # -> out, a; inputs x: Line
# ---------- python_7: Python ----------
"""Constructs a recursive Koch curve.
    Inputs:
        x: The original line. (Line)
        y: The the number of subdivisions. (int)
    Outputs:
        a: The Koch curve, as a list of lines.
"""
import Rhino.Geometry as rg
import math


def Main():
    global a # as usual, you can assign to the global scope with the "global" keyword
    a = []
    SubdivideAndRotate(x, 0)

def WeightedAvaragePts(pt1, pt2, pt1_part):
    rest = 1 - pt1_part
    return pt1 * rest + pt2 * pt1_part

def SubdivideAndRotate(line, level):
    if level == y:
        a.append(line)
        return
    
    f = line.From #you can use "rg.Line." for exploring methods
    t = line.To
    b = WeightedAvaragePts(f, t, 1.0 / 3.0)
    c = WeightedAvaragePts(f, t, 2.0 / 3.0)
    
    m = WeightedAvaragePts(f, t, 0.5)
    bm = m - b
    
    e1 = bm / math.cos(angle)
    e1.Rotate(angle, rg.Vector3d(0,0,1))
    e = e1 + b
    
    level += 1
    
    SubdivideAndRotate(rg.Line(f, b), level)
    SubdivideAndRotate(rg.Line(b, e), level)
    SubdivideAndRotate(rg.Line(e, c), level)
    SubdivideAndRotate(rg.Line(c, t), level)

if x is None: x = rg.Line(rg.Point3d(0,0,0), rg.Point3d(10,10,0))
if y is None: y = 4
angle = math.pi / 3

Main()
# ---------- end python_7 ----------

# ----
panel_21 = Panel(python_7.a)

pop2d = Populate2D(Region={Plane=PlaneXY(0, 0, 0), Size=Domain2(u=0..20, v=0..10)}, Count=100, Seed=1)

# ---- group: GH FUNCTIONS
python_8 = GhPythonScript(points=pop2d)  # -> out, a; inputs points: list of Point3d
# ---------- python_8: Python ----------
"""
Creates Voronoi cells using Grasshopper functionality.
    Inputs:
        points: The Voronoi cell center points. (Point3d hint, List Access)
    Outputs:
        a: The Voronoi diagram computed by Grasshopper.
"""

# See http://stevebaer.wordpress.com/2013/12/12/ghpython-outside-the-canvas/
# Steve Baer's blog post for more information about this functionality
# Set input to Point3d hint, and List Access, and give it the 'points' name
# to make the example work

import ghpythonlib.components as ghcomp
 
# call Voronoi component with input points
a = ghcomp.Voronoi(points)
# ---------- end python_8 ----------

# ----
panel_22 = Panel(python_8.a)
